# Grasshopper definition GeometryCA.ghx (Grasshopper 1.0.4)

verticalgeneration = Slider(9, range=0..100)
ring = Slider(25, range=0..1000)
div = Slider(50, range=0..1000)
number_slider = Slider(75, range=0..100)
number_slider_2 = Slider(0, range=0..10)
number_slider_3 = Slider(255, range=0..255)
number_slider_4 = Slider(169, range=0..1000)
number_slider_5 = Slider(225, range=0..1000)
number_slider_6 = Slider(129, range=0..1000)
number_slider_7 = Slider(109, range=0..1000)
number_slider_8 = Slider(30, range=0..1000)
# Rules
number_slider_9 = Slider(110, range=0..1000)
number_slider_10 = Slider(135, range=0..1000)
number_slider_11 = Slider(182, range=0..1000)
random = Random(Range=Domain(0, 1), Number=div, Seed=Slider(34, range=0..100))
number_slider_12 = Slider(20, range=0..100)
larger = LargerThan(FirstNumber=random, SecondNumber=Slider(0.3, range=0..1))  # -> LargerThan, OrEqualTo
python = PythonScript(div=div, genRing=ring, genVtc=verticalgeneration, ruleInt=Slider(90, range=0..100), init=larger.LargerThan)  # -> out, cellOut, rule; inputs div: Int32, genRing: Int32, genVtc: Int32, ruleInt: Int32, init: list of Int32
# ---------- python: Python ----------
import random
import copy

class Cell:
    def __init__(self):
        self.state = 0
        self.nextState = 0
        self.adj = 0
        self.case = 0
        self.age = 0
        self.inLine = -1
        
    def clear(self):
        self.inLine = -1
    
    def update(self, cells):
        self.case = 0
        for i in range(3):
            if cells[self.adj[i]].state == 1:
                self.case += pow(2, i)
        self.nextState = rule[self.case]
        
    def updateState(self):
        self.state = self.nextState
        self.age += 1

def makeRule():
    global rule
    binary = bin(ruleInt)
    binStr = str(binary)
    if len(binStr) < 10:
        for i in range(10 - len(binStr)):
            binStr = binStr[:2] + '0' + binStr[2:]
    
    for i in range(8):
        rule.append(int(binStr[9-i]))

def main():
    
    firstGen = []
    
    for i in range(div):
        cell = Cell()
        if i == 0:
            cell.adj = [div-1, i, i+1]
        elif i == div - 1:
            cell.adj = [i-1, i, 0]
        else:
            cell.adj = [i-1, i, i+1]
        cell.state = init[i]
        firstGen.append(cell)
    
    makeRule()
    
    cellGens = []
    curGen = firstGen
    cellGens.append(copy.deepcopy(curGen))
    
    for i in range(1, genRing + genVtc - 1):
        for cell in curGen:
            cell.update(curGen)
        for cell in curGen:
            cell.updateState()
        cellGens.append(copy.deepcopy(curGen))
    
    for i in range(genVtc):
        cellVtc = []
        for j in range(genRing):
            cellRing = []
            for k in range(div):
                cellRing.append(copy.deepcopy(cellGens[i+j][k]))
            cellVtc.append(cellRing)
        cellOut.append(cellVtc)

cellOut = []
rule = []
main()
# ---------- end python ----------
# 2D
python_2 = GhPythonScript(div=div, ring=ring, vtc=verticalgeneration, length=number_slider_12)  # -> out, pts; inputs div: Int32, ring: Int32, vtc: Int32; disabled
# ---------- python_2: Python ----------
__author__ = "me"

import rhinoscriptsyntax as rs
import math

pts = []

altitude = []
azimuth = []

altInterval = (math.pi / 2) / ring
aziInterval = 2 * math.pi / div

for i in range(0, ring):
    altitude.append(math.pi / 2 - altInterval * i)

for i in range(div):
    azimuth.append(aziInterval * i)

for i in range(1, vtc+1):
    r = length * i
    ptsVtc = []
    for j in range(1, ring+1):
        ptsRing = []
        for k in range(div):
            x = j * r * math.cos(azimuth[k])
            y = j * r * math.sin(azimuth[k])
            z = 0
            ptsRing.append((x,y,z))
        ptsVtc.append(ptsRing)
    pts.append(ptsVtc)
# ---------- end python_2 ----------
# 3D Sphere
python_3 = GhPythonScript(div=div, ring=ring, vtc=verticalgeneration, length=number_slider_12)  # -> out, pts; inputs div: Int32, ring: Int32, vtc: Int32; disabled
# ---------- python_3: Python ----------
__author__ = "me"

import rhinoscriptsyntax as rs
import math

pts = []

altitude = []
azimuth = []

altInterval = (math.pi / 2) / ring
aziInterval = 2 * math.pi / div

for i in range(1, ring+1):
    altitude.append(math.pi / 2 - altInterval * i)

for i in range(div):
    azimuth.append(aziInterval * i)

for i in range(1, vtc+1):
    r = length * i
    ptsVtc = []
    for j in range(ring):
        ptsRing = []
        for k in range(div):
            x = r * math.cos(azimuth[k]) * math.cos(altitude[j])
            y = r * math.sin(azimuth[k]) * math.cos(altitude[j])
            z = r * math.sin(altitude[j])
            ptsRing.append((x,y,z))
        ptsVtc.append(ptsRing)
    pts.append(ptsVtc)
# ---------- end python_3 ----------
# 4D Sphere
python_4 = GhPythonScript(div=div, ring=ring, vtc=verticalgeneration, length=number_slider_12)  # -> out, pts; inputs div: Int32, ring: Int32, vtc: Int32
# ---------- python_4: Python ----------
__author__ = "me"

import rhinoscriptsyntax as rs
import math

pts = []

altitude = []
azimuth = []

altInterval = (math.pi / 2) / ring
aziInterval = 2 * math.pi / div

for i in range(1, ring+1):
    altitude.append(math.pi / 2 - altInterval * i)

for i in range(div):
    azimuth.append(aziInterval * i)

for i in range(1, vtc+1):
    r = length
    ptsVtc = []
    for j in range(ring):
        ptsRing = []
        for k in range(div):
            x = r * math.cos(azimuth[k]) * math.sin(altitude[j])
            y = r * math.sin(azimuth[k]) * math.sin(altitude[j])
            z = r * math.cos(altitude[j])
            w = r * i
            ptsRing.append((x,y,z,w))
        ptsVtc.append(ptsRing)
    pts.append(ptsVtc)
# ---------- end python_4 ----------
series = Series(Start=number_slider_12, Step=number_slider_12, Count=verticalgeneration)
number_slider_13 = Slider(229, range=0..1000)  # disabled
number_slider_14 = Slider(180, range=0..1000)  # disabled
number_slider_15 = Slider(150, range=0..1000)  # disabled
# Projection Source Point
number_slider_16 = Slider(0, range=-10..10)
# Rotation 4D
number_slider_17 = Slider(0, range=0..360)
addition = Addition(A=series, B=Slider(0, range=-10..10))
# Rotation 3D
python_5 = GhPythonScript(pts=python_4.pts, x=number_slider_14, y=number_slider_15, z=number_slider_13)  # -> out, ptsOut; inputs pts: list; disabled
# ---------- python_5: Python ----------
__author__ = "me"

import rhinoscriptsyntax as rs
import math as m

ptsOut = []

lGen = len(pts)
lRing = len(pts[0])
lDiv = len(pts[0][0])

for i in range(lGen):
    gen = []
    for j in range(lRing):
        ring = []
        for k in range(lDiv):
            x1 = pts[i][j][k][0]
            y1 = pts[i][j][k][1]
            z1 = pts[i][j][k][2]
            cX = m.cos(m.radians(x))
            sX = m.sin(m.radians(x))
            cY = m.cos(m.radians(y))
            sY = m.sin(m.radians(y))
            cZ = m.cos(m.radians(z))
            sZ = m.sin(m.radians(z))
            
            x0 = x1 * (cY*cZ) - y1 * (cY*sZ) + z1 * (sY)
            y0 = x1 * (sX*sY*cZ + cX*sZ) + y1 * (cX*cZ - sX*sY*sZ) - z1 * (sX*cY)
            z0 = x1 * (sX*sZ - cX*sY*cZ) + y1 * (cX*sY*sZ + sX*cZ) + z1 * (cX*cY)
            ring.append([x0, y0, z0])
        gen.append(ring)
    ptsOut.append(gen)
# ---------- end python_5 ----------
pt = ConstructPoint(XCoordinate=number_slider_16, YCoordinate=Slider(0, range=-10..10), ZCoordinate=addition)
python_6 = GhPythonScript(
    pts=python_4.pts,
    XY=number_slider_17,
    XZ=Slider(180, range=0..360),
    XW=Slider(0, range=0..360),
    YZ=Slider(0, range=0..360),
    YW=Slider(4, range=0..30),
    ZW=Slider(349, range=0..360))  # -> out, ptsOut; inputs pts: list
# ---------- python_6: Python ----------
__author__ = "me"

import rhinoscriptsyntax as rs
import math

ptsOut = []

lGen = len(pts)
lRing = len(pts[0])
lDiv = len(pts[0][0])

for i in range(lGen):
    gen = []
    for j in range(lRing):
        ring = []
        for k in range(lDiv):
            x1 = pts[i][j][k][0]
            y1 = pts[i][j][k][1]
            z1 = pts[i][j][k][2]
            w1 = pts[i][j][k][3]
            vec = [x1,y1,z1,w1]
            angles = [XY, XZ, XW, YZ, YW, ZW]
            
            for l in range(len(angles)):
                
                angle = math.radians(angles[l])
                c = math.cos(angle)
                s = math.sin(angle)
                
                rotationMatrix = [
                [[c,s,0,0]  ,[-s,c,0,0] ,[0,0,1,0] ,[0,0,0,1]  ],
                [[c,0,-s,0] ,[0,1,0,0]  ,[s,0,c,0] ,[0,0,0,1]  ],
                [[c,0,0,s]  ,[0,1,0,0]  ,[0,0,1,0] ,[-s,0,0,c] ],
                [[1,0,0,0]  ,[0,c,s,0]  ,[0,-s,c,0],[0,0,0,1]  ],
                [[1,0,0,0]  ,[0,c,0,-s] ,[0,0,1,0] ,[0,s,0,c]  ],
                [[1,0,0,0]  ,[0,1,0,0]  ,[0,0,c,-s],[0,0,s,c]  ]
                ]
                
                matrix = rotationMatrix[l]
                
                newVec = []
                for m in range(4):#matrix
                    sum = 0
                    for n in range(4):#vec
                        sum += vec[n] * matrix[m][n]
                    newVec.append(sum)
                vec = newVec
            ring.append(vec)
        gen.append(ring)
    ptsOut.append(gen)
# ---------- end python_6 ----------
# Stereographic Project 3D to 2D
python_7 = GhPythonScript(pts=python_6.ptsOut, cen=pt)  # -> out, ptsOut; inputs pts: list, cen: list of Point3d; disabled
# ---------- python_7: Python ----------
__author__ = "me"

import rhinoscriptsyntax as rs
import math

ptsOut = []

lGen = len(pts)
lRing = len(pts[0])
lDiv = len(pts[0][0])

for i in range(lGen):
    gen = []
    x1 = cen[i][0]
    y1 = cen[i][1]
    z1 = cen[i][2]
    for j in range(lRing):
        ring = []
        for k in range(lDiv):
            x = pts[i][j][k][0]
            y = pts[i][j][k][1]
            z = pts[i][j][k][2]
            x0 = (z * x1 - z1 * x) / (z - z1)
            y0 = (z * y1 - z1 * y) / (z - z1)
            ring.append([x0, y0, 0])
        gen.append(ring)
    ptsOut.append(gen)
# ---------- end python_7 ----------
# Stereographic Project 4D to 3D
python_8 = GhPythonScript(pts=python_6.ptsOut, radius=Slider(12.43, range=0..100))  # -> out, ptsOut; inputs pts: list
# ---------- python_8: Python ----------
__author__ = "me"

import rhinoscriptsyntax as rs
import math

ptsOut = []

lGen = len(pts)
lRing = len(pts[0])
lDiv = len(pts[0][0])

for i in range(lGen):
    gen = []
    for j in range(lRing):
        ring = []
        for k in range(lDiv):
            x = pts[i][j][k][0]
            y = pts[i][j][k][1]
            z = pts[i][j][k][2]
            w = pts[i][j][k][3]
            
            amp = 0
            amp += x ** 2
            amp += y ** 2
            amp += z ** 2
            amp += w ** 2
            amp = math.sqrt(amp)
            
            x *= radius / amp
            y *= radius / amp
            z *= radius / amp
            w *= radius / amp
            
            x0 = x * radius / (radius - w)
            y0 = y * radius / (radius - w)
            z0 = z * radius / (radius - w)
            
            ring.append([x0, y0, z0])
        gen.append(ring)
    ptsOut.append(gen)
# ---------- end python_8 ----------
toggle = BooleanToggle(True)
# Display Srfs
python_9 = GhPythonScript(cells=python.cellOut, pts=python_8.ptsOut, flip=toggle, pos=Slider(0, range=0..10))  # -> out, cells, lines, srfs; inputs cells: list, pts: list, flip: Int32, pos: Int32
# ---------- python_9: Python ----------
__author__ = "me"

class Line:
    def __init__(self):
        self.inSrf = -1
        self.cIndex = [] #the i,j,k in cells[]
        self.pts = [] #the actual points
    
    def clear(self):
        self.index = -1

genVtc = len(cells)
genRing = len(cells[0])
div = len(cells[0][0])

lines = []

for i in range(genVtc):
    for j in range(genRing):
        for k in range(div):
            cells[i][j][k].clear()

for i in range(genVtc):
    lineVtc = []
    lineID = 0
    for j in range(1, genRing):
        for k in range(div):
            now = cells[i][j][k]
            if now.state == flip:
                beforeDiv = now.adj[pos]
                before = cells[i][j-1][beforeDiv]
                if before.state == flip:
                    if before.inLine == -1:
                        line = Line()
                        line.cIndex.append([i, j-1, beforeDiv])
                        line.cIndex.append([i, j, k])
                        line.pts.append(pts[i][j-1][beforeDiv])
                        line.pts.append(pts[i][j][k])
                        now.inLine = lineID
                        before.inLine = lineID
                        lineVtc.append(line)
                        lineID += 1
                    else:
                        lineVtc[before.inLine].cIndex.append([i,j,k])
                        lineVtc[before.inLine].pts.append(pts[i][j][k])
                        now.inLine = before.inLine
    lines.append(lineVtc)

srfs = []
srfID = 0

for i in range(genVtc):
    for j in range(len(lines[i])):
        lines[i][j].clear()

for i in range(1, genVtc):
    for j in range(len(lines[i])):
        line = lines[i][j]
        si = line.cIndex[0] #si = the index of the cell that is at the start of the line
        start = cells[si[0]][si[1]][si[2]]
        srf = []
        if si[1] < genRing - 2:
            cellBefore = cells[i-1][si[1]+1][si[2]]
            lineBefore = lines[i-1][cellBefore.inLine]
            if lineBefore.inSrf == -1:
                srf.append([i-1, cellBefore.inLine])
                srf.append([i, j])
                lineBefore.inSrf = srfID
                line.inSrf = srfID
                srfs.append(srf)
                srfID += 1
            else:
                id = lineBefore.inSrf
                srfs[id].append([i, j])
                line.inSrf = id
# ---------- end python_9 ----------
python_10 = GhPythonScript(cells=python.cellOut, pts=python_8.ptsOut, flip=toggle, pos=Slider(2, range=0..10))  # -> out, cells, lines, srfs; inputs cells: list, pts: list, flip: Int32, pos: Int32
# ---------- python_10: Python ----------
__author__ = "me"

import rhinoscriptsyntax as rs

class Line:
    def __init__(self):
        self.inSrf = -1
        self.cIndex = [] #the i,j,k in cells[]
        self.pts = [] #the actual points
    
    def clear(self):
        self.index = -1

genVtc = len(cells)
genRing = len(cells[0])
div = len(cells[0][0])

lines = []

for i in range(genVtc):
    for j in range(genRing):
        for k in range(div):
            cells[i][j][k].clear()

for i in range(genVtc):
    lineVtc = []
    lineID = 0
    for j in range(1, genRing):
        for k in range(div):
            now = cells[i][j][k]
            if now.state == flip:
                beforeDiv = now.adj[pos]
                before = cells[i][j-1][beforeDiv]
                if before.state == flip:
                    if before.inLine == -1:
                        line = Line()
                        line.cIndex.append([i, j-1, beforeDiv])
                        line.cIndex.append([i, j, k])
                        line.pts.append(pts[i][j-1][beforeDiv])
                        line.pts.append(pts[i][j][k])
                        now.inLine = lineID
                        before.inLine = lineID
                        lineVtc.append(line)
                        lineID += 1
                    else:
                        lineVtc[before.inLine].cIndex.append([i,j,k])
                        lineVtc[before.inLine].pts.append(pts[i][j][k])
                        now.inLine = before.inLine
    lines.append(lineVtc)

srfs = []
srfID = 0

for i in range(genVtc):
    for j in range(len(lines[i])):
        lines[i][j].clear()

for i in range(1, genVtc):
    for j in range(len(lines[i])):
        line = lines[i][j]
        si = line.cIndex[0] #si = the index of the cell that is at the start of the line
        start = cells[si[0]][si[1]][si[2]]
        srf = []
        if si[1] < genRing - 2:
            cellBefore = cells[i-1][si[1]+1][si[2]]
            lineBefore = lines[i-1][cellBefore.inLine]
            if lineBefore.inSrf == -1:
                srf.append([i-1, cellBefore.inLine])
                srf.append([i, j])
                lineBefore.inSrf = srfID
                line.inSrf = srfID
                srfs.append(srf)
                srfID += 1
            else:
                id = lineBefore.inSrf
                srfs[id].append([i, j])
                line.inSrf = id

for i in srfs:
    print i
# ---------- end python_10 ----------
python_11 = GhPythonScript(cells=python.cellOut, pts=python_8.ptsOut, flip=toggle, pos=Slider(1, range=0..1))  # -> out, cells, lines, srfs; inputs cells: list, pts: list, flip: Int32, pos: Int32; same code as python_10
python_12 = GhPythonScript(cells=python_9.cells, lines=python_9.lines, srfs=python_9.srfs)  # -> out, curves, walls; inputs cells: list, lines: list, srfs: list
# ---------- python_12: Python ----------
__author__ = "me"

import rhinoscriptsyntax as rs

curves = []
temp = []
walls = []

"""
for i in lines:
    for line in i:
        print line
        curves.append(rs.AddCurve(line.pts))"""

for srf in srfs:
    forSrf = []
    for i in srf:
        crv = rs.AddCurve(lines[i[0]][i[1]].pts)
        curves.append(crv)
        forSrf.append(crv)
    bakeSrf = rs.AddLoftSrf(forSrf)
    walls.append(bakeSrf[0])
# ---------- end python_12 ----------
python_13 = GhPythonScript(cells=python_11.cells, lines=python_11.lines, srfs=python_11.srfs)  # -> out, curves, walls; inputs cells: list, lines: list, srfs: list; same code as python_12
python_14 = GhPythonScript(cells=python_10.cells, lines=python_10.lines, srfs=python_10.srfs)  # -> out, curves, walls; inputs cells: list, lines: list, srfs: list; same code as python_12
merge = Merge(Data1=python_12.curves, Data2=python_13.curves, Data3=python_14.curves)
merge_2 = Merge(Data1=python_12.walls, Data2=python_13.walls, Data3=python_14.walls)
